# Requirement set BravoRequirements (R2020b)

## 1 [User Interface] Requirements focused on the UI/UX after drone deployment (Container)

### 1.1 [Direct Control] Operator can take direct control of a single drone with a controller.
Keywords: Customer, Functional

### 1.2 [Operational Complexity] Manual operation of drone should not be complex.
Keywords: Customer, Functional

### 1.3 [Data to Display] Drones must include battery life, flight stats, drone position, obstacle warning, battery warning indicators.
Keywords: Supplier, Functional

### 1.4 [UI Customization] UI of ground control should be highly customizable to present data for each drone and let user decide how data is displayed.
Keywords: Supplier, Functional

### 1.5 [Camera Display] Every drone should have its camera feed displayed at the ground station.
Keywords: Supplier, Functional

### 1.6 [Thermal Switch] Must have an option to switch between thermal and optical camera view.
Keywords: Supplier, Functional

## 2 [Control System] Requirements focused on the control system software used on the Ground Control station (Container)

### 2.1 [Position Designation] Operator must be able to designate positions for drones to manoeuvre to.
Keywords: Customer, Functional

### 2.2 [Recall Button] A “recall button” should be included to make all drones return to station on demand.
Keywords: Supplier, Functional

### 2.3 [GC Autonomy Handling] Ground station must handle all autonomous control (except object evasion for each unit) and transmit control signals to drones.
Keywords: Supplier, Performance

## 3 [Data Transmission] Requirements focused on the sending and recieving of data to and from the Ground Control station (Container)

### 3.1 [Seperate Communication] Ground station must be able to communicate to drones separately.
Keywords: Supplier, Functional

### 3.2 [Signal Decoding] Ground station must be able to encode and decode signals sent to and from drones respectively.
Keywords: Supplier, Functional

### 3.3 [Video Quality] The camera feed of the drone must be of sufficient quality for face recognition.
Keywords: Supplier, Performance

### 3.4 [Signal Power] Ground Control must have a strong R/T setup to receive and transmit data in long distances through concrete structures.
Keywords: Supplier, Reliability

### 3.5 [Data Encryption] Signals should be encrypted to prevent hacking/data leak .
Keywords: Supplier, Reliability

## 4 [Maintenance and Operation] Requirements focused on the upkeep of the system and deployment of the system (Container)

### 4.1 [System Size] All equipment must fit within and be operated from a standard police van
Keywords: Customer, Performance

### 4.2 [Setup Time] The equipment must have a quick setup time.
Keywords: Customer, Performance

### 4.3 [Software Upkeep] The drone control software can be easily maintained and is upgradeable.
Keywords: Supplier, Maintenability

### 4.4 [Hardware Upkeep] The hardware components of the ground control and drone should be cost-efficient to maintain.
Keywords: Supplier, Maintenability