% Requirement links of Ground_Control_SC.slx (R2020b)

block :1 implements BravoRequirements.slreqx#19: Signal Decoding: Ground station must be able to encode and decode signals sent to and from drones respectively.
block :1 implements BravoRequirements.slreqx#18: Seperate Communication: Ground station must be able to communicate to drones separately.
block :19 implements BravoRequirements.slreqx#22: Data Encryption: Signals should be encrypted to prevent hacking/data leak .
block :31 implements BravoRequirements.slreqx#10: Data to Display: Drones must include battery life, flight stats, drone position, obstacle warning, battery warning indicators.
block :31 implements BravoRequirements.slreqx#13: Camera Display: Every drone should have its camera feed displayed at the ground station.
block :32 implements BravoRequirements.slreqx#14: Thermal Switch: Must have an option to switch between standard and optical camera view.
block :32 implements BravoRequirements.slreqx#11: Position Designation: Operator must be able to designate positions for drones to manoeuvre to.
block :32 implements BravoRequirements.slreqx#15: Recall Button: A “recall button” should be included to make all drones return to station on demand.
block :38 implements BravoRequirements.slreqx#12: UI Customization: UI of ground control should be highly customizable to present data for each drone and let user decide how data is displayed.
block :46 implements BravoRequirements.slreqx#16: GC Autonomy Handling: Ground station must handle all autonomous control (except object evasion for each unit) and transmit control signals to drones.
block :47 implements BravoRequirements.slreqx#5: Direct Control: Operator can take direct control of a single drone with a controller.